# Grasshopper definition ParametricLCAScript_V1.0.gh (Grasshopper 1.0.7)
# Copyright: 2022
# plug-ins: Wombat, LunchBox, Human, DeCodingSpaces

# ---- group: Inputs for the building geometry and lifetime
length = Slider(30, range=1..50)
floor_height = Slider(4, range=3..6)
# Parametric LCA Script V1.0
# Parametric Life-Cycle Assessment in Early-stage Building Design
# 11/12-2022
# Input
width = Slider(18, range=1..50)
no_of_floors = Slider(10, range=1..10)
max_grid = Slider(9, range=4..10)
window_ratio = Slider(0.5, range=0.1..0.9)
column_size = Slider(0.4, range=0.2..0.6)
beam_size = Slider(0.4, range=0.2..0.6)
# Preview
building_lifetime = Slider(50, range=1..100)

# ---- group: Create the overall building geometry to get areas for terrain, floor slabs and roof
dom = ConstructDomain(DomainStart=0, DomainEnd=width)
dom_2 = ConstructDomain(DomainStart=0, DomainEnd=length)
dom_3 = ConstructDomain(DomainStart=0, DomainEnd=floor_height)
box = DomainBox(Base=PlaneXY(0, 0, 0), X=dom, Y=dom_2, Z=dom_3)
Z = UnitZ(Factor=floor_height)
arrlinear = LinearArray(Geometry=box, Direction=Z, Count=no_of_floors)  # -> Geometry, Transform
debrep = DeconstructBrep(Brep=arrlinear.Geometry)  # -> simplify(Faces), Edges, Vertices
item = ListItem(List=debrep.Faces, Index="4", Wrap=True)
item_2 = ListItem(List=debrep.Faces, Index="5", Wrap=True)
rev = ReverseList(List=flatten(item_2))
split = SplitList(List=flatten(item), Index="1")  # -> ListA, ListB
item_3 = ListItem(List=rev, Index=0, Wrap=True)
floor_slabs = Geometry(split.ListB)
terrain = Geometry(split.ListA)
roof = Geometry(item_3)

# ---- group: Split the exterior walls based on the grid
panel = Panel("""0
1
2
3""")
item_4 = ListItem(List=debrep.Faces, Index=panel, Wrap=True)
debrep_2 = DeconstructBrep(Brep=item_4)  # -> Faces, Edges, Vertices
item_5 = ListItem(List=debrep_2.Edges, Index=0, Wrap=True)
len = Length(Curve=item_5)
division = Division(A=len, B=max_grid)
divide = DivideCurve(Curve=item_5, Count=division, Kinks=False)  # -> Points, Tangents, Parameters
line = LineSDL(Start=divide.Points, Direction=Vector(0, 0, 1), Length=floor_height)
srfsplit = SurfaceSplit(Surface=graft(item_4), Curves=simplify(line))

# ---- group: Create the interior walls based on the grid
split_2 = SplitList(List=divide.Points, Index="1")  # -> ListA, ListB
split_3 = SplitList(List=reverse(split_2.ListB), Index="1")  # -> ListA, ListB
simplify = SimplifyTree(Tree=split_3.ListB, Front=False)
tstat = TreeStatistics(Tree=simplify)  # -> Paths, Length, Count
panel_2 = Panel("""True
False""")
cull = CullPattern(List=tstat.Paths, CullPattern=invert(panel_2))
cull_2 = CullPattern(List=tstat.Paths, CullPattern=panel_2)
branch = TreeBranch(Tree=simplify, Path=cull_2, MaintainPaths=True)
branch_2 = TreeBranch(Tree=simplify, Path=cull, MaintainPaths=True)
tstat_2 = TreeStatistics(Tree=branch)  # -> Paths, Length, Count
tstat_3 = TreeStatistics(Tree=branch_2)  # -> Paths, Length, Count
panel_3 = Panel("""True
False""")
panel_4 = Panel("""True
False""")
cull_3 = CullPattern(List=tstat_2.Paths, CullPattern=invert(panel_3))
cull_4 = CullPattern(List=tstat_3.Paths, CullPattern=invert(panel_4))
cull_5 = CullPattern(List=tstat_2.Paths, CullPattern=panel_3)
cull_6 = CullPattern(List=tstat_3.Paths, CullPattern=panel_4)
branch_3 = TreeBranch(Tree=branch, Path=cull_5, MaintainPaths=True)
branch_4 = TreeBranch(Tree=branch, Path=cull_3, MaintainPaths=True)  # -> reverse(Branch)
branch_5 = TreeBranch(Tree=branch_2, Path=cull_6, MaintainPaths=True)
branch_6 = TreeBranch(Tree=branch_2, Path=cull_4, MaintainPaths=True)  # -> reverse(Branch)
ln = Line(StartPoint=branch_3, EndPoint=branch_4)
ln_2 = Line(StartPoint=branch_5, EndPoint=branch_6)
Z_2 = UnitZ(Factor=floor_height)
geo = Geometry([ln_2, ln])
extr = Extrude(Base=geo, Direction=Z_2)
interior_wall = Geometry(extr)

# ---- group: Divide in ground floor and above floors
tstat_4 = TreeStatistics(Tree=srfsplit)  # -> Paths, Length, Count
panel_5 = Panel("""{
;""")
split_4 = TextSplit(Text=tstat_4.Paths, Separators=panel_5)
item_6 = ListItem(List=split_4, Index="1", Wrap=True)  # -> flatten(Item)
equals = Equality(FirstNumber=item_6, SecondNumber="0")  # -> Equality, Inequality
cull_7 = CullPattern(List=tstat_4.Paths, CullPattern=equals.Equality)
cull_8 = CullPattern(List=tstat_4.Paths, CullPattern=equals.Inequality)
branch_7 = TreeBranch(Tree=srfsplit, Path=cull_7, MaintainPaths=True)
branch_8 = TreeBranch(Tree=srfsplit, Path=cull_8, MaintainPaths=True)

# ---- group: Create the columns
subtraction = Subtraction(A=floor_height, B=beam_size)
trim = TrimTree(Tree=geo, Depth=1)
mcx = MultipleCurves(Curves=trim)  # -> Points, IndexA, IndexB, ParamA, ParamB
trim_2 = TrimTree(Tree=divide.Points, Depth="2")
division_2 = Division(A=column_size, B=width)
division_3 = Division(A=column_size, B=length)
division_4 = Division(A=subtraction, B=floor_height)
merge = Merge(Data1=trim_2, Data2=mcx.Points)
scale_nu = ScaleNU(Geometry=graft(arrlinear.Geometry), Plane=merge, ScaleX=division_2, ScaleY=division_3, ScaleZ=division_4)  # -> Geometry, Transform
columns = Geometry(scale_nu.Geometry)

# ---- group: Create the beams
geo_2 = Geometry(debrep_2.Edges)
geo_3 = Geometry(simplify(ln))
geo_4 = Geometry(simplify(ln_2))
item_7 = ListItem(List=geo_2, Index=0, Wrap=True)
trim_3 = TrimTree(Tree=item_7, Depth=1)
panel_6 = Panel("""1
3""")
panel_7 = Panel("""0
2""")
item_8 = ListItem(List=trim_3, Index=panel_6, Wrap=True)
item_9 = ListItem(List=trim_3, Index=panel_7, Wrap=True)
Z_3 = UnitZ(Factor=floor_height)
move = Move(Geometry=[geo_3, item_8], Motion=Z_3)  # -> Geometry, Transform
move_2 = Move(Geometry=[geo_4, item_9], Motion=Z_3)  # -> Geometry, Transform
midpt = CurveMiddle(Curve=move.Geometry)
midpt_2 = CurveMiddle(Curve=move_2.Geometry)
division_5 = Division(A=beam_size, B=width)
division_6 = Division(A=beam_size, B=floor_height)
division_7 = Division(A=beam_size, B=length)
division_8 = Division(A=beam_size, B=floor_height)
scale_nu_2 = ScaleNU(Geometry=graft(arrlinear.Geometry), Plane=midpt, ScaleX=division_5, ScaleY=1, ScaleZ=division_6)  # -> simplify(Geometry), Transform
scale_nu_3 = ScaleNU(Geometry=graft(arrlinear.Geometry), Plane=midpt_2, ScaleX=1, ScaleY=division_7, ScaleZ=division_8)  # -> simplify(Geometry), Transform
beams = Geometry([scale_nu_2.Geometry, scale_nu_3.Geometry])

# ---- group: Create doors
debrep_3 = DeconstructBrep(Brep=branch_7)  # -> Faces, Edges, Vertices
mp = Midpoint(Curve=debrep_3.Edges)
pdecon = Deconstruct(Point=mp)  # -> XComponent, YComponent, ZComponent
sort = SortList(Keys=pdecon.ZComponent)  # -> Keys, ValuesA
item_10 = ListItem(List=sort.Keys, Index=0, Wrap=True)
equals_2 = Equality(FirstNumber=pdecon.ZComponent, SecondNumber=item_10)  # -> Equality, Inequality
cull_9 = CullPattern(List=debrep_3.Edges, CullPattern=equals_2.Equality)
mp_2 = Midpoint(Curve=cull_9)
len_2 = Length(Curve=cull_9)
division_9 = Division(A="1", B=len_2)
scale = Scale(Geometry=cull_9, Center=mp_2, Factor=division_9)  # -> Geometry, Transform
Z_4 = UnitZ(Factor="2")
extr_2 = Extrude(Base=scale.Geometry, Direction=Z_4)
trim_4 = TrimTree(Tree=extr_2, Depth=1)

# ---- group: Create windows
area = Area(Geometry=branch_8)  # -> Area, Centroid
scale_2 = Scale(Geometry=branch_8, Center=area.Centroid, Factor=window_ratio)  # -> Geometry, Transform

# ---- group: Split into exterior walls, exterior doors and windows
data = Data([trim_4, scale_2.Geometry])
srfsplit_2 = SurfaceSplit(Surface=srfsplit, Curves=data)  # -> simplify(Fragments)
# Create geometry
item_11 = ListItem(List=srfsplit_2, Index=0, Wrap=True)
item_12 = ListItem(List=srfsplit_2, Index="1", Wrap=True)
trim_5 = TrimTree(Tree=item_12, Depth="2")
tstat_5 = TreeStatistics(Tree=trim_5)  # -> Paths, Length, Count
split_5 = SplitList(List=tstat_5.Paths, Index="1")  # -> ListA, ListB
branch_9 = TreeBranch(Tree=trim_5, Path=split_5.ListA, MaintainPaths=True)
branch_10 = TreeBranch(Tree=trim_5, Path=split_5.ListB, MaintainPaths=True)

# ----
exterior_door = Geometry(branch_9)
exterior_wall = Geometry(item_11)
windows = Geometry(branch_10)

# ---- group: Extrude surfaces for visuals
geo_5 = Geometry(terrain)
geo_6 = Geometry(floor_slabs)
geo_7 = Geometry(roof)
geo_8 = Geometry(exterior_wall)
normals = NormalsMANI(geo=geo_8)  # -> center_2, norm_2, P
# Visuals
panel_8 = Panel("-0.5")
multiplication = Multiplication(A=normals.norm_2, B="0.1")
Z_5 = UnitZ(Factor=panel_8)
Z_6 = UnitZ(Factor="0.2")
Z_7 = UnitZ(Factor="0.3")
extr_3 = Extrude(Base=geo_5, Direction=Z_5)
extr_4 = Extrude(Base=geo_6, Direction=Z_6)
extr_5 = Extrude(Base=geo_7, Direction=Z_7)
extr_6 = Extrude(Base=geo_8, Direction=multiplication)

# ---- group: Find quantities of all building components
building_area = Geometry(item)
foundation = Geometry(terrain)
terrain_2 = Geometry(terrain)
floor_slabs_2 = Geometry(floor_slabs)
roof_2 = Geometry(roof)
exterior_wall_2 = Geometry(exterior_wall)
windows_2 = Geometry(windows)
exterior_door_2 = Geometry(exterior_door)
interior_wall_2 = Geometry(interior_wall)
columns_2 = Geometry(columns)
beams_2 = Geometry(beams)
category = Panel("""Foundation
Terrain
Floor slabs
Roofing
Exterior wall
Windows
Exterior door
Interior wall
Interior door
Columns
Beams""")
# Quantities
area_2 = Area(Geometry=flatten(building_area))  # -> Area, Centroid
debrep_4 = DeconstructBrep(Brep=foundation)  # -> Faces, Edges, Vertices
area_3 = Area(Geometry=flatten(terrain_2))  # -> Area, Centroid
area_4 = Area(Geometry=flatten(floor_slabs_2))  # -> Area, Centroid
area_5 = Area(Geometry=flatten(roof_2))  # -> Area, Centroid
area_6 = Area(Geometry=flatten(exterior_wall_2))  # -> Area, Centroid
area_7 = Area(Geometry=flatten(windows_2))  # -> Area, Centroid
area_8 = Area(Geometry=flatten(exterior_door_2))  # -> Area, Centroid
area_9 = Area(Geometry=flatten(interior_wall_2))  # -> Area, Centroid
volume = Volume(Geometry=flatten(columns_2))  # -> Volume, Centroid
volume_2 = Volume(Geometry=flatten(beams_2))  # -> Volume, Centroid
len_3 = Length(Curve=debrep_4.Edges)
interior_doors = Panel("10")
cluster = Cluster(data=area_9.Area, A=interior_doors)  # -> R, R_2
ma = MassAddition(Input=cluster.R)  # -> Result, PartialResults
ma_2 = MassAddition(Input=cluster.R_2)  # -> Result, PartialResults
ma_3 = MassAddition(Input=area_2.Area)  # -> Result, PartialResults
ma_4 = MassAddition(Input=len_3)  # -> Result, PartialResults
ma_5 = MassAddition(Input=area_3.Area)  # -> Result, PartialResults
ma_6 = MassAddition(Input=area_4.Area)  # -> Result, PartialResults
ma_7 = MassAddition(Input=area_5.Area)  # -> Result, PartialResults
ma_8 = MassAddition(Input=area_6.Area)  # -> Result, PartialResults
ma_9 = MassAddition(Input=area_7.Area)  # -> Result, PartialResults
ma_10 = MassAddition(Input=area_8.Area)  # -> Result, PartialResults
ma_11 = MassAddition(Input=volume.Volume)  # -> Result, PartialResults
ma_12 = MassAddition(Input=volume_2.Volume)  # -> Result, PartialResults
panel_9 = Panel("m")
panel_10 = Panel(ma_5.Result)
panel_11 = Panel(ma_6.Result)
panel_12 = Panel("m2")
panel_13 = Panel("m2")
panel_14 = Panel(ma_9.Result)
panel_15 = Panel("m2")
panel_16 = Panel(ma_10.Result)
panel_17 = Panel("m2")
panel_18 = Panel(ma.Result)
panel_19 = Panel("m2")
panel_20 = Panel(ma_2.Result)
panel_21 = Panel("m2")
panel_22 = Panel(ma_3.Result)
panel_23 = Panel("m2")
panel_24 = Panel(ma_4.Result)
panel_25 = Panel("m2")
panel_26 = Panel(ma_7.Result)
panel_27 = Panel("m2")
panel_28 = Panel(ma_8.Result)
panel_29 = Panel(ma_11.Result)
panel_30 = Panel("m3")
panel_31 = Panel(ma_12.Result)
panel_32 = Panel("m3")

# ---- group: Show the building geometry in Rhino
columns_3 = Geometry(columns_2)
beams_3 = Geometry(beams_2)
foundation_2 = Geometry(extr_3)
floor_slabs_3 = Geometry(extr_4)
roof_3 = Geometry(extr_5)
exterior_wall_3 = Geometry(extr_6)
windows_3 = Geometry(windows_2)
doors = Geometry(exterior_door_2)
interior_wall_3 = Geometry(interior_wall_2)
preview = CustomPreview(Geometry=foundation_2, Material=ColourSwatch(SwatchColor=RGB(100, 100, 100)))
preview_2 = CustomPreview(Geometry=floor_slabs_3, Material=ColourSwatch(SwatchColor=RGB(200, 200, 200)))
preview_3 = CustomPreview(Geometry=roof_3, Material=ColourSwatch(SwatchColor=RGB(255, 100, 0)))
preview_4 = CustomPreview(Geometry=exterior_wall_3, Material=ColourSwatch(SwatchColor=RGB(200, 200, 200)))
preview_5 = CustomPreview(Geometry=windows_3, Material=ColourSwatch(SwatchColor=RGBA(150, 240, 255, 100)))
preview_6 = CustomPreview(Geometry=doors, Material=ColourSwatch(SwatchColor=RGB(255, 196, 153)))
preview_7 = CustomPreview(Geometry=interior_wall_3, Material=ColourSwatch(SwatchColor=RGB(255, 255, 200)))
preview_8 = CustomPreview(Geometry=columns_3, Material=ColourSwatch(SwatchColor=RGB(150, 150, 150)))
preview_9 = CustomPreview(Geometry=beams_3, Material=ColourSwatch(SwatchColor=RGB(150, 150, 150)))

# ---- group: Find quantities of all building components / Collect all units in a list
merge_2 = Merge(
    Data1=panel_9,
    Data2=panel_25,
    Data3=panel_12,
    Data4=panel_27,
    Data5=panel_13,
    Data6=panel_15,
    Data7=panel_17,
    Data8=panel_19,
    Data9=panel_21,
    Data10=panel_30,
    Data11=panel_32)  # -> flatten(Result)
unit = Panel(merge_2)

# ---- group: Find quantities of all building components / Collect all quantities in a list
merge_3 = Merge(
    Data1=panel_24,
    Data2=panel_10,
    Data3=panel_11,
    Data4=panel_26,
    Data5=panel_28,
    Data6=panel_14,
    Data7=panel_16,
    Data8=panel_18,
    Data9=panel_20,
    Data10=panel_29,
    Data11=panel_31)  # -> flatten(Result)
unit_2 = Panel(merge_3)

# ---- group: Find the Excel path and read the data
path = FilePath("C:\Users\CHOE\Danmarks Tekniske Universitet\DREAM TEAM (LCA & Grasshopper) - General\FINAL\EPD Database.xlsx")
excelread = ExcelReader(ReadExcelData=Toggle(False), WorkbookPath=path, WorksheetName="Table")  # -> Exceptions, ExcelData

# ---- group: Update and internalise for faster use
data_2 = Data(Tree({0}: ["Component_All", "Exterior wall", "Exterior wall", "Exterior wall", "Exterior wall", "Exterior wall"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], {1}: ["Unit_All", "m2", "m2", "m2", "m2", "m2"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], {2}: ["Product_All", "Structure", "Structure", "Structure", "Structure", "Structure"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], {3}: ["Material_All", "Concrete", "Concrete", "Concrete", "Wood", "Wood"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], {4}: ["Name", "Concrete element, Ambercon", "Reinforced concrete (C30/37)", "Reinforced concrete (C25)", "Glulam construction wood products of spruce, Lilleheden", "Construction wood in pine and spruce, Palsgaard spær"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], {5}: ["Lifetime", "120", "120", "120", "120", "120"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]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))

# ----
# Import from Excel
split_6 = SplitList(List=data_2, Index="1")  # -> ListA, ListB

# ---- group: Remove rows with no values
flip = FlipMatrix(Data=split_6.ListB)
ma_13 = MassAddition(Input=flip)  # -> Result, PartialResults
larger = LargerThan(FirstNumber=ma_13.Result, SecondNumber="0")  # -> LargerThan, OrEqualTo
cull_10 = CullPattern(List=flip, CullPattern=larger.LargerThan)
clean = CleanTree(RemoveNulls=True, RemoveInvalid=True, RemoveEmpty=True, Tree=cull_10)  # -> simplify(Tree)
flip_2 = FlipMatrix(Data=clean)
lca_data = Data(flip_2)

# ---- group: Collect all headers
split_7 = TextSplit(Text=split_6.ListA, Separators="_")
item_13 = ListItem(List=split_7, Index=0, Wrap=True)  # -> flatten(Item)
headers = Data(item_13)

# ---- group: Remove values without end-of-life scenario (C3-C4)
headers_2 = Data(headers)
data_3 = Data(lca_data)
mindex = MemberIndex(Set=headers_2, Member="C3-C4")  # -> Index, Count
branch_11 = TreeBranch(Tree=data_3, Path=mindex.Index, MaintainPaths=True)
equals_3 = Equality(FirstNumber=branch_11, SecondNumber="0")  # -> Equality, Inequality
cull_11 = CullPattern(List=data_3, CullPattern=equals_3.Inequality)

# ---- group: Add replacements in B4 based on product lifetime and A1-A3 + C3-C4
mindex_2 = MemberIndex(Set=headers_2, Member="A1-A3")  # -> Index, Count
mindex_3 = MemberIndex(Set=headers_2, Member="Lifetime")  # -> Index, Count
branch_12 = TreeBranch(Tree=cull_11, Path=mindex.Index, MaintainPaths=True)
branch_13 = TreeBranch(Tree=cull_11, Path=mindex_2.Index, MaintainPaths=True)
branch_14 = TreeBranch(Tree=cull_11, Path=mindex_3.Index, MaintainPaths=True)
building_lifetime_2 = Data(building_lifetime)
division_10 = Division(A=building_lifetime_2, B=branch_14)
addition = Addition(A=branch_12, B=branch_13)
round = Round(Number=division_10)  # -> Nearest, Floor, Ceiling
mindex_4 = MemberIndex(Set=headers_2, Member="B4")  # -> Index, Count
flip_3 = FlipMatrix(Data=cull_11)
subtraction_2 = Subtraction(A=round.Ceiling, B="1")
multiplication_2 = Multiplication(A=addition, B=subtraction_2)  # -> simplify(graft(Result))
replace = ReplaceItems(List=flip_3, Item=multiplication_2, Indices=mindex_4.Index, Wrap=False)  # -> simplify(List)
flip_4 = FlipMatrix(Data=replace)
lca_data_2 = Data(flip_4)

# ---- group: Add A4 if not stated
mindex_5 = MemberIndex(Set=headers_2, Member="Weight(kg/FU)")  # -> Index, Count
mindex_6 = MemberIndex(Set=headers_2, Member="A4")  # -> Index, Count
branch_15 = TreeBranch(Tree=lca_data_2, Path=mindex_5.Index, MaintainPaths=True)
branch_16 = TreeBranch(Tree=lca_data_2, Path=mindex_6.Index, MaintainPaths=True)
distance_of_transportation_km = Panel("500")
co2_factor_of_truck_kgco2e_kg_km = Panel("8.97E-05")
equals_4 = Equality(FirstNumber=branch_16, SecondNumber="0")  # -> Equality, Inequality
multiplication_3 = Multiplication(A=branch_15, B=distance_of_transportation_km, C=co2_factor_of_truck_kgco2e_kg_km)
int = Integer(equals_4.Equality)
int_2 = Integer("1")
mindex_7 = MemberIndex(Set=int, Member=int_2)  # -> Index, Count
item_14 = ListItem(List=multiplication_3, Index=mindex_7.Index, Wrap=True)
flip_5 = FlipMatrix(Data=lca_data_2)
replace_2 = ReplaceItems(List=branch_16, Item=item_14, Indices=mindex_7.Index, Wrap=False)  # -> simplify(graft(List))
replace_3 = ReplaceItems(List=flip_5, Item=replace_2, Indices=mindex_6.Index, Wrap=False)  # -> simplify(List)
flip_6 = FlipMatrix(Data=replace_3)

# ---- group: Add A5 if not stated
panel_33 = Panel("""A1-A3
A4
C3-C4""")
mindex_8 = MemberIndex(Set=headers_2, Member=panel_33)  # -> flatten(Index), Count
mindex_9 = MemberIndex(Set=headers_2, Member="A5")  # -> Index, Count
branch_17 = TreeBranch(Tree=flip_6, Path=mindex_8.Index, MaintainPaths=True)
branch_18 = TreeBranch(Tree=flip_6, Path=mindex_9.Index, MaintainPaths=True)
flip_7 = FlipMatrix(Data=branch_17)
waste_factor = Panel("0.1")
equals_5 = Equality(FirstNumber=branch_18, SecondNumber="0")  # -> Equality, Inequality
ma_14 = MassAddition(Input=flip_7)  # -> flatten(Result), PartialResults
multiplication_4 = Multiplication(A=ma_14.Result, B=waste_factor)
int_3 = Integer(equals_5.Equality)
int_4 = Integer("1")
mindex_10 = MemberIndex(Set=int_3, Member=int_4)  # -> Index, Count
item_15 = ListItem(List=multiplication_4, Index=mindex_10.Index, Wrap=True)
flip_8 = FlipMatrix(Data=flip_6)
replace_4 = ReplaceItems(List=branch_18, Item=item_15, Indices=mindex_10.Index, Wrap=False)  # -> simplify(graft(List))
replace_5 = ReplaceItems(List=flip_8, Item=replace_4, Indices=mindex_9.Index, Wrap=False)  # -> simplify(List)
flip_9 = FlipMatrix(Data=replace_5)

# ---- group: Sort in building categories
# Data modification
data_4 = Data(flip_9)
mindex_11 = MemberIndex(Set=item_13, Member="Component")  # -> Index, Count
branch_19 = TreeBranch(Tree=data_4, Path=mindex_11.Index, MaintainPaths=True)
tsort = SortText(Keys=branch_19, Culture=127)  # -> Keys, Values
dcon = DeleteConsecutive(Set=tsort.Keys, Wrap=False)  # -> Set, Count
mindex_12 = MemberIndex(Set=branch_19, Member=dcon.Set)  # -> simplify(Index), Count

# ----
categories = Data(dcon.Set)
lca_data_3 = Data(data_4)
headers_3 = Data(headers)
sorting = Data(mindex_12.Index)

# ---- group: Find subcategories for the component
panel_34 = Panel("Beams")
component = Component(
    headers=headers_3,
    lca_data=lca_data_3,
    sorting=sorting,
    categories=categories,
    data=panel_34,
    category_unit=unit,
    categories_match=category)  # -> headers_3, category_lca_data_2, subcategory_index_2, subcategories_2, subcategory_range_2
bang = ExplodeTree(Data=graft(component.subcategory_range_2))

# ----
component_2 = Component(
    headers=headers_3,
    lca_data=lca_data_3,
    sorting=sorting,
    categories=categories,
    data="Columns",
    category_unit=unit,
    categories_match=category)  # -> headers_3, category_lca_data_2, subcategory_index_2, subcategories_2, subcategory_range_2
bang_2 = ExplodeTree(Data=graft(component_2.subcategory_range_2))

component_3 = Component(
    headers=headers_3,
    lca_data=lca_data_3,
    sorting=sorting,
    categories=categories,
    data="Exterior door",
    category_unit=unit,
    categories_match=category)  # -> headers_3, category_lca_data_2, subcategory_index_2, subcategories_2, subcategory_range_2
bang_3 = ExplodeTree(Data=graft(component_3.subcategory_range_2))

component_4 = Component(
    headers=headers_3,
    lca_data=lca_data_3,
    sorting=sorting,
    categories=categories,
    data="Exterior wall",
    category_unit=unit,
    categories_match=category)  # -> headers_3, category_lca_data_2, subcategory_index_2, subcategories_2, subcategory_range_2
bang_4 = ExplodeTree(Data=graft(component_4.subcategory_range_2))  # -> Branch0, Branch1, Branch2, Branch3, Branch4

component_5 = Component(
    headers=headers_3,
    lca_data=lca_data_3,
    sorting=sorting,
    categories=categories,
    data="Floor slabs",
    category_unit=unit,
    categories_match=category)  # -> headers_3, category_lca_data_2, subcategory_index_2, subcategories_2, subcategory_range_2
bang_5 = ExplodeTree(Data=graft(component_5.subcategory_range_2))  # -> Branch0, Branch1, Branch2

component_6 = Component(
    headers=headers_3,
    lca_data=lca_data_3,
    sorting=sorting,
    categories=categories,
    data="Foundation",
    category_unit=unit,
    categories_match=category)  # -> headers_3, category_lca_data_2, subcategory_index_2, subcategories_2, subcategory_range_2
bang_6 = ExplodeTree(Data=graft(component_6.subcategory_range_2))  # -> Branch0, Branch1

component_7 = Component(
    headers=headers_3,
    lca_data=lca_data_3,
    sorting=sorting,
    categories=categories,
    data="Interior door",
    category_unit=unit,
    categories_match=category)  # -> headers_3, category_lca_data_2, subcategory_index_2, subcategories_2, subcategory_range_2
bang_7 = ExplodeTree(Data=graft(component_7.subcategory_range_2))

component_8 = Component(
    headers=headers_3,
    lca_data=lca_data_3,
    sorting=sorting,
    categories=categories,
    data="Interior wall",
    category_unit=unit,
    categories_match=category)  # -> headers_3, category_lca_data_2, subcategory_index_2, subcategories_2, subcategory_range_2
bang_8 = ExplodeTree(Data=graft(component_8.subcategory_range_2))  # -> Branch0, Branch1, Branch2, Branch3

component_9 = Component(
    headers=headers_3,
    lca_data=lca_data_3,
    sorting=sorting,
    categories=categories,
    data="Roofing",
    category_unit=unit,
    categories_match=category)  # -> headers_3, category_lca_data_2, subcategory_index_2, subcategories_2, subcategory_range_2
bang_9 = ExplodeTree(Data=graft(component_9.subcategory_range_2))  # -> Branch0, Branch1, Branch2

component_10 = Component(
    headers=headers_3,
    lca_data=lca_data_3,
    sorting=sorting,
    categories=categories,
    data="Terrain",
    category_unit=unit,
    categories_match=category)  # -> headers_3, category_lca_data_2, subcategory_index_2, subcategories_2, subcategory_range_2
bang_10 = ExplodeTree(Data=graft(component_10.subcategory_range_2))  # -> Branch0, Branch1, Branch2

component_11 = Component(
    headers=headers_3,
    lca_data=lca_data_3,
    sorting=sorting,
    categories=categories,
    data="Windows",
    category_unit=unit,
    categories_match=category)  # -> headers_3, category_lca_data_2, subcategory_index_2, subcategories_2, subcategory_range_2
bang_11 = ExplodeTree(Data=graft(component_11.subcategory_range_2))

product = Product(
    headers=component_4.headers_3,
    category_lca_data=component_4.category_lca_data_2,
    subcategory_index=component_4.subcategory_index_2,
    subcategories=component_4.subcategories_2,
    subcategory_number=bang_4.Branch0)  # -> headers_3, subcategory_lca_data_2, subcategory_2
panel_35 = Panel(product.subcategory_2)
material = Material(subcategory_lca_data=product.subcategory_lca_data_2, headers=product.headers_3)  # -> subcategory_lca_data_3, material_list_2, materials_2
list = ItemSelector(material.materials_2, {"Brick", "Fibercement", "Metal", "Slate", "Wood"}, selected=[])
select = Select(subcategory_lca_data=material.subcategory_lca_data_3, material_list=material.material_list_2, material=list)
material_2 = Material_2(material_lca_data=select, headers=product.headers_3)  # -> material_lca_data_3, product_list_2, products_2
list_2 = ItemSelector(
    material_2.products_2,
    {"12 slate, Cupa Pizarras", "Aluminium FC facade system, Kalzip", "Aluminium panel cladding, GDA", "Bamboo cladding, Moso", "Colour, Steni", "D-bricks, Petersen Tegl", "EXT gran, Woodify", "Facade cladding cassette, Ruuki and Vimpeli", "Facade stone, Kiviry", "Gray bricks, Randers Tegl"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}, selected=[])
select_2 = Select(subcategory_lca_data=material_2.material_lca_data_3, material_list=material_2.product_list_2, material=list_2)
impact = Impact(lca_data=select_2, headers=product.headers_3)

product_2 = Product(
    headers=component_4.headers_3,
    category_lca_data=component_4.category_lca_data_2,
    subcategory_index=component_4.subcategory_index_2,
    subcategories=component_4.subcategories_2,
    subcategory_number=bang_4.Branch1)  # -> headers_3, subcategory_lca_data_2, subcategory_2
panel_36 = Panel(product_2.subcategory_2)
material_3 = Material(subcategory_lca_data=product_2.subcategory_lca_data_2, headers=product_2.headers_3)  # -> subcategory_lca_data_3, material_list_2, materials_2
list_3 = ItemSelector(material_3.materials_2, {"Glass wool", "Stone wool", "Wood fibre"}, selected=[])
select_3 = Select(subcategory_lca_data=material_3.subcategory_lca_data_3, material_list=material_3.material_list_2, material=list_3)
material_4 = Material_2(material_lca_data=select_3, headers=product_2.headers_3)  # -> material_lca_data_3, product_list_2, products_2
list_4 = ItemSelector(
    material_4.products_2,
    {"Air-injected insulation, Steico", "Flex 036, Steico", "Formstykker, Isover", "Glass wool, Glava", "Glass wool, Knauf", "Granulate stone wool, Rockwool Denmark", "Kretsull, Isover", "Mineral wool, Knauf", "NATURA, Paroc Group", "Stone wool, Rockwool Denmark", "Stone wool, Rockwool Norway"}, selected=[])
select_4 = Select(subcategory_lca_data=material_4.material_lca_data_3, material_list=material_4.product_list_2, material=list_4)
impact_2 = Impact(lca_data=select_4, headers=product_2.headers_3)

product_3 = Product(
    headers=component_4.headers_3,
    category_lca_data=component_4.category_lca_data_2,
    subcategory_index=component_4.subcategory_index_2,
    subcategories=component_4.subcategories_2,
    subcategory_number=bang_4.Branch2)  # -> headers_3, subcategory_lca_data_2, subcategory_2
panel_37 = Panel(product_3.subcategory_2)
material_5 = Material(subcategory_lca_data=product_3.subcategory_lca_data_2, headers=product_3.headers_3)  # -> subcategory_lca_data_3, material_list_2, materials_2
list_5 = ItemSelector(material_5.materials_2, {"Gypsum", "Wood"}, selected=[])
select_5 = Select(subcategory_lca_data=material_5.subcategory_lca_data_3, material_list=material_5.material_list_2, material=list_5)
material_6 = Material_2(material_lca_data=select_5, headers=product_3.headers_3)  # -> material_lca_data_3, product_list_2, products_2
list_6 = ItemSelector(
    material_6.products_2,
    {"Classic board, Knauf", "ErgoLite, Saint-Gobain Gyproc", "Furu, Woodify", "Gypsum fiber board, German Gypsum Assoc,", "Habito, Saint-Gobain Gyproc", "Light board, Knauf", "Protect F, Saint-Gobain Gyproc", "Rehab A, Norgips", "Secura board, Knauf", "Solid wet board, Knauf", "Ultra Board, Knauf", "Vanerply, Moelven Wood", "Wall panel, FIBO", "WallBoard, Saint-Gobain Gyproc", "WISA plywood coated, UPM Plywood Oy", "WISA plywood uncoated, UPM Plywood Oy"}, selected=[])
select_6 = Select(subcategory_lca_data=material_6.material_lca_data_3, material_list=material_6.product_list_2, material=list_6)
impact_3 = Impact(lca_data=select_6, headers=product_3.headers_3)

product_4 = Product(
    headers=component_5.headers_3,
    category_lca_data=component_5.category_lca_data_2,
    subcategory_index=component_5.subcategory_index_2,
    subcategories=component_5.subcategories_2,
    subcategory_number=bang_5.Branch0)  # -> headers_3, subcategory_lca_data_2, subcategory_2
panel_38 = Panel(product_4.subcategory_2)
material_7 = Material(subcategory_lca_data=product_4.subcategory_lca_data_2, headers=product_4.headers_3)  # -> subcategory_lca_data_3, material_list_2, materials_2
list_7 = ItemSelector(material_7.materials_2, {"Bio based accoustic insulation", "Mineral acoustic ceiling"}, selected=[])
select_7 = Select(subcategory_lca_data=material_7.subcategory_lca_data_3, material_list=material_7.material_list_2, material=list_7)
material_8 = Material_2(material_lca_data=select_7, headers=product_4.headers_3)  # -> material_lca_data_3, product_list_2, products_2
list_8 = ItemSelector(
    material_8.products_2,
    {"Acoustic ceiling tile or wall, Rockfon Arctic", "Clinic Edge E, PARAFON", "Gyptone with Activ’Air, Gyproc", "Hygiene Clinic E, Ecophon", "Søuld mats", "Sound absorbing tiles, Parafon", "TOPAKUSTIK®  Panels, Veneer Finish": "TOPAKUSTIK® Panels, Veneer Finish", "Troldtekt futureCEM grey unpainted 25 mm", "Troldtekt Natural wood, unpainted 25 mm"}, selected=[])
select_8 = Select(subcategory_lca_data=material_8.material_lca_data_3, material_list=material_8.product_list_2, material=list_8)
impact_4 = Impact(lca_data=select_8, headers=product_4.headers_3)

product_5 = Product(
    headers=component_5.headers_3,
    category_lca_data=component_5.category_lca_data_2,
    subcategory_index=component_5.subcategory_index_2,
    subcategories=component_5.subcategories_2,
    subcategory_number=bang_5.Branch1)  # -> headers_3, subcategory_lca_data_2, subcategory_2
panel_39 = Panel(product_5.subcategory_2)
material_9 = Material(subcategory_lca_data=product_5.subcategory_lca_data_2, headers=product_5.headers_3)  # -> subcategory_lca_data_3, material_list_2, materials_2
list_9 = ItemSelector(material_9.materials_2, {"Carpet", "Ceramic", "Linoleum", "Vinyl", "Wood"}, selected=[])
select_9 = Select(subcategory_lca_data=material_9.subcategory_lca_data_3, material_list=material_9.material_list_2, material=list_9)
material_10 = Material_2(material_lca_data=select_9, headers=product_5.headers_3)  # -> material_lca_data_3, product_list_2, products_2
list_10 = ItemSelector(
    material_10.products_2,
    {"Belon Flooring Rolls, Armstrong Flooring", "BioLith, BioMason", "Ceramic Floor Tile, Kale Kaleseramik Ceramic Floor Tiles Levent Turkey", "Ceramic Tile, Mrazzi Group", "Ceramic Tiles  Fiorano, Emilgroup": "Ceramic Tiles Fiorano, Emilgroup", "Desso Ecobase Carpet, Tarkett", "DLW Linoleum Compact, Gerflor", "Engineered Wood Floor, Kährs", "Expona Design, James Halstead PLC", "Floor Tile, Graniser Ceramics"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}, selected=[])
select_10 = Select(subcategory_lca_data=material_10.material_lca_data_3, material_list=material_10.product_list_2, material=list_10)
impact_5 = Impact(lca_data=select_10, headers=product_5.headers_3)

product_6 = Product(
    headers=component_5.headers_3,
    category_lca_data=component_5.category_lca_data_2,
    subcategory_index=component_5.subcategory_index_2,
    subcategories=component_5.subcategories_2,
    subcategory_number=bang_5.Branch2)  # -> headers_3, subcategory_lca_data_2, subcategory_2
panel_40 = Panel(product_6.subcategory_2)
material_11 = Material(subcategory_lca_data=product_6.subcategory_lca_data_2, headers=product_6.headers_3)  # -> subcategory_lca_data_3, material_list_2, materials_2
list_11 = ItemSelector(material_11.materials_2, {"CLT with 95 mm isolation", "Hollow core deck"}, selected=[])
select_11 = Select(subcategory_lca_data=material_11.subcategory_lca_data_3, material_list=material_11.material_list_2, material=list_11)
material_12 = Material_2(material_lca_data=select_11, headers=product_6.headers_3)  # -> material_lca_data_3, product_list_2, products_2
list_12 = ItemSelector(
    material_12.products_2,
    {"220 mm huldæk, Boligbeton", "220 mm huldæk, Contiga", "220 mm huldæk, Spæncom", "CLT RIB panel, branhce EPD m. 95 mm rockwool", "CLT RIB panel, Stora ENSO m. 95 mm rockwool"}, selected=[])
select_12 = Select(subcategory_lca_data=material_12.material_lca_data_3, material_list=material_12.product_list_2, material=list_12)
impact_6 = Impact(lca_data=select_12, headers=product_6.headers_3)

product_7 = Product(
    headers=component_9.headers_3,
    category_lca_data=component_9.category_lca_data_2,
    subcategory_index=component_9.subcategory_index_2,
    subcategories=component_9.subcategories_2,
    subcategory_number=bang_9.Branch0)  # -> headers_3, subcategory_lca_data_2, subcategory_2
panel_41 = Panel(product_7.subcategory_2)
material_13 = Material(subcategory_lca_data=product_7.subcategory_lca_data_2, headers=product_7.headers_3)  # -> subcategory_lca_data_3, material_list_2, materials_2
list_13 = ItemSelector(
    material_13.materials_2,
    {"Bio based accoustic insulation", "Mineral acoustic ceiling", "Roofing felt", "Slate", "Tile"}, selected=[])
select_13 = Select(subcategory_lca_data=material_13.subcategory_lca_data_3, material_list=material_13.material_list_2, material=list_13)
material_14 = Material_2(material_lca_data=select_13, headers=product_7.headers_3)  # -> material_lca_data_3, product_list_2, products_2
list_14 = ItemSelector(
    material_14.products_2,
    {"Acoustic ceiling tile or wall, Rockfon Arctic", "Clinic Edge E, PARAFON", "Double-S, Wing economy, IBF", "Gyptone with Activ’Air, Gyproc", "Heavy roof slate, Cupa Pizarras", "Hygiene Clinic E, Ecophon", "LCAbyg konstruktion: Tagbelægning, tagpap": "LCAbyg konstruktion: Tagbelægning, tagpap ", "Roof slate, Cupa Pizarras", "Roofing felt, phønix tag", "Roofing tiles, Ziegel", "Søuld mats", "Sound absorbing tiles, Parafon", "TOPAKUSTIK®  Panels, Veneer Finish": "TOPAKUSTIK® Panels, Veneer Finish", "Troldtekt futureCEM grey unpainted 25 mm", "Troldtekt Natural wood, unpainted 25 mm"}, selected=[])
select_14 = Select(subcategory_lca_data=material_14.material_lca_data_3, material_list=material_14.product_list_2, material=list_14)
impact_7 = Impact(lca_data=select_14, headers=product_7.headers_3)

product_8 = Product(
    headers=component_9.headers_3,
    category_lca_data=component_9.category_lca_data_2,
    subcategory_index=component_9.subcategory_index_2,
    subcategories=component_9.subcategories_2,
    subcategory_number=bang_9.Branch1)  # -> headers_3, subcategory_lca_data_2, subcategory_2
panel_42 = Panel(product_8.subcategory_2)
material_15 = Material(subcategory_lca_data=product_8.subcategory_lca_data_2, headers=product_8.headers_3)  # -> subcategory_lca_data_3, material_list_2, materials_2
list_15 = ItemSelector(material_15.materials_2, {"Glass wool", "Stone wool", "Wood fibre"}, selected=[])
select_15 = Select(subcategory_lca_data=material_15.subcategory_lca_data_3, material_list=material_15.material_list_2, material=list_15)
material_16 = Material_2(material_lca_data=select_15, headers=product_8.headers_3)  # -> material_lca_data_3, product_list_2, products_2
list_16 = ItemSelector(
    material_16.products_2,
    {"Air-injected insulation, Steico", "Flex 036, Steico", "Formstykker, Isover", "Glass wool, Glava", "Glass wool, Knauf", "Granulate stone wool, Rockwool Denmark", "Kretsull, Isover", "Mineral wool, Knauf", "NATURA, Paroc Group", "Stone wool, Rockwool Denmark", "Stone wool, Rockwool Norway"}, selected=[])
select_16 = Select(subcategory_lca_data=material_16.material_lca_data_3, material_list=material_16.product_list_2, material=list_16)
impact_8 = Impact(lca_data=select_16, headers=product_8.headers_3)

product_9 = Product(
    headers=component_9.headers_3,
    category_lca_data=component_9.category_lca_data_2,
    subcategory_index=component_9.subcategory_index_2,
    subcategories=component_9.subcategories_2,
    subcategory_number=bang_9.Branch2)  # -> headers_3, subcategory_lca_data_2, subcategory_2
panel_43 = Panel(product_9.subcategory_2)
material_17 = Material(subcategory_lca_data=product_9.subcategory_lca_data_2, headers=product_9.headers_3)  # -> subcategory_lca_data_3, material_list_2, materials_2
list_17 = ItemSelector(material_17.materials_2, {"Hollow core deck", "Joist Concrete deck", "Wood"}, selected=[])
select_17 = Select(subcategory_lca_data=material_17.subcategory_lca_data_3, material_list=material_17.material_list_2, material=list_17)
material_18 = Material_2(material_lca_data=select_17, headers=product_9.headers_3)  # -> material_lca_data_3, product_list_2, products_2
list_18 = ItemSelector(
    material_18.products_2,
    {"220 mm huldæk, Boligbeton", "220 mm huldæk, Contiga", "220 mm huldæk, Spæncom", "Construction wood in pine and spruce, Palsgaard spær", "Cross laminated timber, Duobalken", "Glulam construction wood products of spruce, Lilleheden", "TT Concrete element, Ambercon", "TT Concrete element, Spæncom"}, selected=[])
select_18 = Select(subcategory_lca_data=material_18.material_lca_data_3, material_list=material_18.product_list_2, material=list_18)
impact_9 = Impact(lca_data=select_18, headers=product_9.headers_3)

product_10 = Product(
    headers=component_10.headers_3,
    category_lca_data=component_10.category_lca_data_2,
    subcategory_index=component_10.subcategory_index_2,
    subcategories=component_10.subcategories_2,
    subcategory_number=bang_10.Branch0)  # -> headers_3, subcategory_lca_data_2, subcategory_2
panel_44 = Panel(product_10.subcategory_2)
material_19 = Material(subcategory_lca_data=product_10.subcategory_lca_data_2, headers=product_10.headers_3)  # -> subcategory_lca_data_3, material_list_2, materials_2
list_19 = ItemSelector(material_19.materials_2, {"Carpet", "Ceramic", "Linoleum", "Stone", "Vinyl", "Wood"}, selected=[])
select_19 = Select(subcategory_lca_data=material_19.subcategory_lca_data_3, material_list=material_19.material_list_2, material=list_19)
material_20 = Material_2(material_lca_data=select_19, headers=product_10.headers_3)  # -> material_lca_data_3, product_list_2, products_2
list_20 = ItemSelector(
    material_20.products_2,
    {"Belon Flooring Rolls, Armstrong Flooring", "BioLith, BioMason", "Ceramic Floor Tile, Kale Kaleseramik Ceramic Floor Tiles Levent Turkey", "Ceramic Tile, Mrazzi Group", "Ceramic Tiles  Fiorano, Emilgroup": "Ceramic Tiles Fiorano, Emilgroup", "Desso Ecobase Carpet, Tarkett", "DLW Linoleum Compact, Gerflor", "Engineered Wood Floor, Kährs", "Expona Design, James Halstead PLC", "Floor Tile, Graniser Ceramics"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}, selected=[])
select_20 = Select(subcategory_lca_data=material_20.material_lca_data_3, material_list=material_20.product_list_2, material=list_20)
impact_10 = Impact(lca_data=select_20, headers=product_10.headers_3)

product_11 = Product(
    headers=component_10.headers_3,
    category_lca_data=component_10.category_lca_data_2,
    subcategory_index=component_10.subcategory_index_2,
    subcategories=component_10.subcategories_2,
    subcategory_number=bang_10.Branch1)  # -> headers_3, subcategory_lca_data_2, subcategory_2
panel_45 = Panel(product_11.subcategory_2)
material_21 = Material(subcategory_lca_data=product_11.subcategory_lca_data_2, headers=product_11.headers_3)  # -> subcategory_lca_data_3, material_list_2, materials_2
list_21 = ItemSelector(material_21.materials_2, {"EPS & XPS"}, selected=[])
select_21 = Select(subcategory_lca_data=material_21.subcategory_lca_data_3, material_list=material_21.material_list_2, material=list_21)
material_22 = Material_2(material_lca_data=select_21, headers=product_11.headers_3)  # -> material_lca_data_3, product_list_2, products_2
list_22 = ItemSelector(
    material_22.products_2,
    {"BEWI - P80 EPS boards", "Sundolitt EPS S80 EPS Insulation", "Sundolitt XPS board"}, selected=[])
# Windows
select_22 = Select(subcategory_lca_data=material_22.material_lca_data_3, material_list=material_22.product_list_2, material=list_22)
impact_11 = Impact(lca_data=select_22, headers=product_11.headers_3)

product_12 = Product(
    headers=component_10.headers_3,
    category_lca_data=component_10.category_lca_data_2,
    subcategory_index=component_10.subcategory_index_2,
    subcategories=component_10.subcategories_2,
    subcategory_number=bang_10.Branch2)  # -> headers_3, subcategory_lca_data_2, subcategory_2
panel_46 = Panel(product_12.subcategory_2)
material_23 = Material(subcategory_lca_data=product_12.subcategory_lca_data_2, headers=product_12.headers_3)  # -> subcategory_lca_data_3, material_list_2, materials_2
list_23 = ItemSelector(material_23.materials_2, {"Reinforced concrete"}, selected=[])
select_23 = Select(subcategory_lca_data=material_23.subcategory_lca_data_3, material_list=material_23.material_list_2, material=list_23)
material_24 = Material_2(material_lca_data=select_23, headers=product_12.headers_3)  # -> material_lca_data_3, product_list_2, products_2
list_24 = ItemSelector(
    material_24.products_2,
    {"Reinforced concrete, (C20/25) (Brance EPD)", "Reinforced concrete, C30/37 (Brance EPD)", "Thomas group solid slab"}, selected=[])
select_24 = Select(subcategory_lca_data=material_24.material_lca_data_3, material_list=material_24.product_list_2, material=list_24)
impact_12 = Impact(lca_data=select_24, headers=product_12.headers_3)

product_13 = Product(
    headers=component_4.headers_3,
    category_lca_data=component_4.category_lca_data_2,
    subcategory_index=component_4.subcategory_index_2,
    subcategories=component_4.subcategories_2,
    subcategory_number=bang_4.Branch3)  # -> headers_3, subcategory_lca_data_2, subcategory_2
panel_47 = Panel(product_13.subcategory_2)
material_25 = Material(subcategory_lca_data=product_13.subcategory_lca_data_2, headers=product_13.headers_3)  # -> subcategory_lca_data_3, material_list_2, materials_2
list_25 = ItemSelector(material_25.materials_2, {"Paint", "Tiles"}, selected=[])
select_25 = Select(subcategory_lca_data=material_25.subcategory_lca_data_3, material_list=material_25.material_list_2, material=list_25)
material_26 = Material_2(material_lca_data=select_25, headers=product_13.headers_3)  # -> material_lca_data_3, product_list_2, products_2
list_26 = ItemSelector(
    material_26.products_2,
    {"Air Pure Supermatt, Sigma Coatings", "Ceramic tile, Marazzi Group", "Clay Plaster Demi Rustic, Clayworks", "Clay Plasters Smooth, Clayworks", "Ecosphere Premium, IEdiSA Graphenstone", "Fiorana ceramic tile, Emilceramica", "Lava glass mosaic, Ezarri", "Porcelain tile, GRESPANIA", "Wall ceramic tile, Mosa"}, selected=[])
select_26 = Select(subcategory_lca_data=material_26.material_lca_data_3, material_list=material_26.product_list_2, material=list_26)
impact_13 = Impact(lca_data=select_26, headers=product_13.headers_3)

product_14 = Product(
    headers=component_4.headers_3,
    category_lca_data=component_4.category_lca_data_2,
    subcategory_index=component_4.subcategory_index_2,
    subcategories=component_4.subcategories_2,
    subcategory_number=bang_4.Branch4)  # -> headers_3, subcategory_lca_data_2, subcategory_2
panel_48 = Panel(product_14.subcategory_2)
material_27 = Material(subcategory_lca_data=product_14.subcategory_lca_data_2, headers=product_14.headers_3)  # -> subcategory_lca_data_3, material_list_2, materials_2
list_27 = ItemSelector(material_27.materials_2, {"Concrete", "Wood"}, selected=[])
select_27 = Select(subcategory_lca_data=material_27.subcategory_lca_data_3, material_list=material_27.material_list_2, material=list_27)
material_28 = Material_2(material_lca_data=select_27, headers=product_14.headers_3)  # -> material_lca_data_3, product_list_2, products_2
list_28 = ItemSelector(
    material_28.products_2,
    {"Concrete element, Ambercon", "Construction wood in pine and spruce, Palsgaard spær", "Cross laminated timber, Duobalken", "Glulam construction wood products of spruce, Lilleheden", "Reinforced concrete (C25)", "Reinforced concrete (C30/37)"}, selected=[])
select_28 = Select(subcategory_lca_data=material_28.material_lca_data_3, material_list=material_28.product_list_2, material=list_28)
impact_14 = Impact(lca_data=select_28, headers=product_14.headers_3)

product_15 = Product(
    headers=component_6.headers_3,
    category_lca_data=component_6.category_lca_data_2,
    subcategory_index=component_6.subcategory_index_2,
    subcategories=component_6.subcategories_2,
    subcategory_number=bang_6.Branch0)  # -> headers_3, subcategory_lca_data_2, subcategory_2
panel_49 = Panel(product_15.subcategory_2)
material_29 = Material(subcategory_lca_data=product_15.subcategory_lca_data_2, headers=product_15.headers_3)  # -> subcategory_lca_data_3, material_list_2, materials_2
list_29 = ItemSelector(material_29.materials_2, {"Leca"}, selected=[])
select_29 = Select(subcategory_lca_data=material_29.subcategory_lca_data_3, material_list=material_29.material_list_2, material=list_29)
material_30 = Material_2(material_lca_data=select_29, headers=product_15.headers_3)  # -> material_lca_data_3, product_list_2, products_2
list_30 = ItemSelector(material_30.products_2, {"Leca Murblock", "Leca XSL 25"}, selected=[])
select_30 = Select(subcategory_lca_data=material_30.material_lca_data_3, material_list=material_30.product_list_2, material=list_30)
impact_15 = Impact(lca_data=select_30, headers=product_15.headers_3)

product_16 = Product(
    headers=component_6.headers_3,
    category_lca_data=component_6.category_lca_data_2,
    subcategory_index=component_6.subcategory_index_2,
    subcategories=component_6.subcategories_2,
    subcategory_number=bang_6.Branch1)  # -> headers_3, subcategory_lca_data_2, subcategory_2
panel_50 = Panel(product_16.subcategory_2)
material_31 = Material(subcategory_lca_data=product_16.subcategory_lca_data_2, headers=product_16.headers_3)  # -> subcategory_lca_data_3, material_list_2, materials_2
list_31 = ItemSelector(material_31.materials_2, {"Pile", "Strip"}, selected=[])
select_31 = Select(subcategory_lca_data=material_31.subcategory_lca_data_3, material_list=material_31.material_list_2, material=list_31)
material_32 = Material_2(material_lca_data=select_31, headers=product_16.headers_3)  # -> material_lca_data_3, product_list_2, products_2
list_32 = ItemSelector(material_32.products_2, {"Concrete 30/37", "Concrete C20/25", "Concrete C20/C25", "Steel"}, selected=[])
select_32 = Select(subcategory_lca_data=material_32.material_lca_data_3, material_list=material_32.product_list_2, material=list_32)
impact_16 = Impact(lca_data=select_32, headers=product_16.headers_3)

product_17 = Product(
    headers=component_11.headers_3,
    category_lca_data=component_11.category_lca_data_2,
    subcategory_index=component_11.subcategory_index_2,
    subcategories=component_11.subcategories_2,
    subcategory_number=bang_11)  # -> headers_3, subcategory_lca_data_2, subcategory_2
panel_51 = Panel(product_17.subcategory_2)
material_33 = Material(subcategory_lca_data=product_17.subcategory_lca_data_2, headers=product_17.headers_3)  # -> subcategory_lca_data_3, material_list_2, materials_2
list_33 = ItemSelector(material_33.materials_2, {"Polymer", "PVC", "Wood", "Wood-alu"}, selected=[])
select_33 = Select(subcategory_lca_data=material_33.subcategory_lca_data_3, material_list=material_33.material_list_2, material=list_33)
material_34 = Material_2(material_lca_data=select_33, headers=product_17.headers_3)  # -> material_lca_data_3, product_list_2, products_2
list_34 = ItemSelector(
    material_34.products_2,
    {"3- layer Window with glassfiber reinforced plastic frame", "3- layer Window with PVC frame", "3- layer Window with wood frame", "3- layer Window with wood/alu frame"}, selected=[])
select_34 = Select(subcategory_lca_data=material_34.material_lca_data_3, material_list=material_34.product_list_2, material=list_34)
impact_17 = Impact(lca_data=select_34, headers=product_17.headers_3)

# ---- group: Select the subcategory to look at
product_18 = Product(
    headers=component.headers_3,
    category_lca_data=component.category_lca_data_2,
    subcategory_index=component.subcategory_index_2,
    subcategories=component.subcategories_2,
    subcategory_number=bang)  # -> headers_3, subcategory_lca_data_2, subcategory_2

# ----
product_19 = Product(
    headers=component_2.headers_3,
    category_lca_data=component_2.category_lca_data_2,
    subcategory_index=component_2.subcategory_index_2,
    subcategories=component_2.subcategories_2,
    subcategory_number=bang_2)  # -> headers_3, subcategory_lca_data_2, subcategory_2
panel_52 = Panel(product_19.subcategory_2)
material_35 = Material(subcategory_lca_data=product_19.subcategory_lca_data_2, headers=product_19.headers_3)  # -> subcategory_lca_data_3, material_list_2, materials_2
list_35 = ItemSelector(material_35.materials_2, {"Reinforced Concrete", "Steel", "Wood"}, selected=[])
select_35 = Select(subcategory_lca_data=material_35.subcategory_lca_data_3, material_list=material_35.material_list_2, material=list_35)
material_36 = Material_2(material_lca_data=select_35, headers=product_19.headers_3)  # -> material_lca_data_3, product_list_2, products_2
list_36 = ItemSelector(
    material_36.products_2,
    {"Construction steel", "Cross Laminated Timber", "Glulam Construction wood", "Reinforced concrete (C25)", "Reinforced concrete (C30/37)"}, selected=[])
select_36 = Select(subcategory_lca_data=material_36.material_lca_data_3, material_list=material_36.product_list_2, material=list_36)
impact_18 = Impact(lca_data=select_36, headers=product_19.headers_3)

product_20 = Product(
    headers=component_3.headers_3,
    category_lca_data=component_3.category_lca_data_2,
    subcategory_index=component_3.subcategory_index_2,
    subcategories=component_3.subcategories_2,
    subcategory_number=bang_3)  # -> headers_3, subcategory_lca_data_2, subcategory_2
panel_53 = Panel(product_20.subcategory_2)
material_37 = Material(subcategory_lca_data=product_20.subcategory_lca_data_2, headers=product_20.headers_3)  # -> subcategory_lca_data_3, material_list_2, materials_2
list_37 = ItemSelector(material_37.materials_2, {"Glassdoor", "Wood door"}, selected=[])
select_37 = Select(subcategory_lca_data=material_37.subcategory_lca_data_3, material_list=material_37.material_list_2, material=list_37)
material_38 = Material_2(material_lca_data=select_37, headers=product_20.headers_3)  # -> material_lca_data_3, product_list_2, products_2
list_38 = ItemSelector(material_38.products_2, {"3-layer glass door med træ/alu ramme", "Wooden/alu door"}, selected=[])
select_38 = Select(subcategory_lca_data=material_38.material_lca_data_3, material_list=material_38.product_list_2, material=list_38)
impact_19 = Impact(lca_data=select_38, headers=product_20.headers_3)

product_21 = Product(
    headers=component_7.headers_3,
    category_lca_data=component_7.category_lca_data_2,
    subcategory_index=component_7.subcategory_index_2,
    subcategories=component_7.subcategories_2,
    subcategory_number=bang_7)  # -> headers_3, subcategory_lca_data_2, subcategory_2
panel_54 = Panel(product_21.subcategory_2)
material_39 = Material(subcategory_lca_data=product_21.subcategory_lca_data_2, headers=product_21.headers_3)  # -> subcategory_lca_data_3, material_list_2, materials_2
list_39 = ItemSelector(material_39.materials_2, {"Wood"}, selected=[])
select_39 = Select(subcategory_lca_data=material_39.subcategory_lca_data_3, material_list=material_39.material_list_2, material=list_39)
material_40 = Material_2(material_lca_data=select_39, headers=product_21.headers_3)  # -> material_lca_data_3, product_list_2, products_2
list_40 = ItemSelector(material_40.products_2, {"Wooden interior door"}, selected=[])
select_40 = Select(subcategory_lca_data=material_40.material_lca_data_3, material_list=material_40.product_list_2, material=list_40)
impact_20 = Impact(lca_data=select_40, headers=product_21.headers_3)

product_22 = Product(
    headers=component_8.headers_3,
    category_lca_data=component_8.category_lca_data_2,
    subcategory_index=component_8.subcategory_index_2,
    subcategories=component_8.subcategories_2,
    subcategory_number=bang_8.Branch0)  # -> headers_3, subcategory_lca_data_2, subcategory_2
panel_55 = Panel(product_22.subcategory_2)
material_41 = Material(subcategory_lca_data=product_22.subcategory_lca_data_2, headers=product_22.headers_3)  # -> subcategory_lca_data_3, material_list_2, materials_2
list_41 = ItemSelector(material_41.materials_2, {"Glass wool", "Stone wool", "Wood fibre"}, selected=[])
select_41 = Select(subcategory_lca_data=material_41.subcategory_lca_data_3, material_list=material_41.material_list_2, material=list_41)
material_42 = Material_2(material_lca_data=select_41, headers=product_22.headers_3)  # -> material_lca_data_3, product_list_2, products_2
list_42 = ItemSelector(
    material_42.products_2,
    {"Air-injected insulation, Steico", "Flex 036, Steico", "Formstykker, Isover", "Glass wool, Glava", "Glass wool, Knauf", "Granulate stone wool, Rockwool Denmark", "Kretsull, Isover", "Mineral wool, Knauf", "NATURA, Paroc Group", "Stone wool, Rockwool Denmark", "Stone wool, Rockwool Norway"}, selected=[])
select_42 = Select(subcategory_lca_data=material_42.material_lca_data_3, material_list=material_42.product_list_2, material=list_42)
impact_21 = Impact(lca_data=select_42, headers=product_22.headers_3)

product_23 = Product(
    headers=component_8.headers_3,
    category_lca_data=component_8.category_lca_data_2,
    subcategory_index=component_8.subcategory_index_2,
    subcategories=component_8.subcategories_2,
    subcategory_number=bang_8.Branch1)  # -> headers_3, subcategory_lca_data_2, subcategory_2
panel_56 = Panel(product_23.subcategory_2)
material_43 = Material(subcategory_lca_data=product_23.subcategory_lca_data_2, headers=product_23.headers_3)  # -> subcategory_lca_data_3, material_list_2, materials_2
list_43 = ItemSelector(material_43.materials_2, {"Gypsum", "Wood"}, selected=[])
select_43 = Select(subcategory_lca_data=material_43.subcategory_lca_data_3, material_list=material_43.material_list_2, material=list_43)
material_44 = Material_2(material_lca_data=select_43, headers=product_23.headers_3)  # -> material_lca_data_3, product_list_2, products_2
list_44 = ItemSelector(
    material_44.products_2,
    {"Classic board, Knauf", "ErgoLite, Saint-Gobain Gyproc", "Furu, Woodify", "Gypsum fiber board, German Gypsum Assoc,", "Habito, Saint-Gobain Gyproc", "Light board, Knauf", "Protect F, Saint-Gobain Gyproc", "Rehab A, Norgips", "Secura board, Knauf", "Solid wet board, Knauf", "Ultra Board, Knauf", "Vanerply, Moelven Wood", "Wall panel, FIBO", "WallBoard, Saint-Gobain Gyproc", "WISA plywood coated, UPM Plywood Oy", "WISA plywood uncoated, UPM Plywood Oy"}, selected=[])
select_44 = Select(subcategory_lca_data=material_44.material_lca_data_3, material_list=material_44.product_list_2, material=list_44)
impact_22 = Impact(lca_data=select_44, headers=product_23.headers_3)

product_24 = Product(
    headers=component_8.headers_3,
    category_lca_data=component_8.category_lca_data_2,
    subcategory_index=component_8.subcategory_index_2,
    subcategories=component_8.subcategories_2,
    subcategory_number=bang_8.Branch2)  # -> headers_3, subcategory_lca_data_2, subcategory_2
panel_57 = Panel(product_24.subcategory_2)
material_45 = Material(subcategory_lca_data=product_24.subcategory_lca_data_2, headers=product_24.headers_3)  # -> subcategory_lca_data_3, material_list_2, materials_2
list_45 = ItemSelector(material_45.materials_2, {"Paint", "Tiles"}, selected=[])
select_45 = Select(subcategory_lca_data=material_45.subcategory_lca_data_3, material_list=material_45.material_list_2, material=list_45)
material_46 = Material_2(material_lca_data=select_45, headers=product_24.headers_3)  # -> material_lca_data_3, product_list_2, products_2
list_46 = ItemSelector(
    material_46.products_2,
    {"Air Pure Supermatt, Sigma Coatings", "Ceramic tile, Marazzi Group", "Clay Plaster Demi Rustic, Clayworks", "Clay Plasters Smooth, Clayworks", "Ecosphere Premium, IEdiSA Graphenstone", "Fiorana ceramic tile, Emilceramica", "Lava glass mosaic, Ezarri", "Porcelain tile, GRESPANIA", "Wall ceramic tile, Mosa"}, selected=[])
select_46 = Select(subcategory_lca_data=material_46.material_lca_data_3, material_list=material_46.product_list_2, material=list_46)
impact_23 = Impact(lca_data=select_46, headers=product_24.headers_3)

product_25 = Product(
    headers=component_8.headers_3,
    category_lca_data=component_8.category_lca_data_2,
    subcategory_index=component_8.subcategory_index_2,
    subcategories=component_8.subcategories_2,
    subcategory_number=bang_8.Branch3)  # -> headers_3, subcategory_lca_data_2, subcategory_2
panel_58 = Panel(product_25.subcategory_2)
material_47 = Material(subcategory_lca_data=product_25.subcategory_lca_data_2, headers=product_25.headers_3)  # -> subcategory_lca_data_3, material_list_2, materials_2
list_47 = ItemSelector(material_47.materials_2, {"Steel", "Wood"}, selected=[])
select_47 = Select(subcategory_lca_data=material_47.subcategory_lca_data_3, material_list=material_47.material_list_2, material=list_47)
material_48 = Material_2(material_lca_data=select_47, headers=product_25.headers_3)  # -> material_lca_data_3, product_list_2, products_2
list_48 = ItemSelector(
    material_48.products_2,
    {"Construction wood in pine and spruce, Palsgaard spær", "Cross laminated timber, Duobalken", "Glulam construction wood products of spruce, Lilleheden", "GSY BEAM galvanized, Give Steel", "GSY GREEN galvanised, Give Steel", "Steel profiles, IB Andersen", "Structural steel, DS Stålkonstruktion"}, selected=[])
select_48 = Select(subcategory_lca_data=material_48.material_lca_data_3, material_list=material_48.product_list_2, material=list_48)
impact_24 = Impact(lca_data=select_48, headers=product_25.headers_3)

# ---- group: Find the different materials in the subcategory
material_49 = Material(subcategory_lca_data=product_18.subcategory_lca_data_2, headers=product_18.headers_3)  # -> subcategory_lca_data_3, material_list_2, materials_2

# ---- group: Choose material
list_49 = ItemSelector(material_49.materials_2, {"Reinforced Concrete", "Steel", "Wood"}, selected=[])

# ---- group: Find the products based on the selected materia
select_49 = Select(subcategory_lca_data=material_49.subcategory_lca_data_3, material_list=material_49.material_list_2, material=list_49)
material_50 = Material_2(material_lca_data=select_49, headers=product_18.headers_3)  # -> material_lca_data_3, product_list_2, products_2

# ---- group: Choose product
list_50 = ItemSelector(
    material_50.products_2,
    {"Construction steel", "Cross Laminated Timber", "Glulam Construction wood", "Reinforced concrete (C25)", "Reinforced concrete (C30/37)"}, selected=[])

# ----
panel_59 = Panel(product_18.subcategory_2)
select_50 = Select(subcategory_lca_data=material_50.material_lca_data_3, material_list=material_50.product_list_2, material=list_50)

# ---- group: Calculate the total LCA subcategory impact
impact_25 = Impact(lca_data=select_50, headers=product_18.headers_3)

# ----
# Beams
# Beams
beams_lca_data = Data(impact_25)

# ---- group: Add the different subcategories in order to find the total component LCA impact
sort_2 = SortList(Keys=beams_lca_data)  # -> Keys, ValuesA
dcon_2 = DeleteConsecutive(Set=sort_2.Keys, Wrap=False)  # -> Set, Count
beams_total_lca_impact = Data(dcon_2.Set)

# ---- group: Multiply with the category quantity and divide with total building area and lifetime
area_10 = Area(categories_area=unit_2, categories=categories, category=panel_34)
multiplication_5 = Multiplication(A=beams_total_lca_impact, B=area_10)
division_11 = Division(A=multiplication_5, B=panel_22)
division_12 = Division(A=division_11, B=building_lifetime)
# Data selection
beams_total_lca_impact_kg_co2_m2_y = Data(division_12)

# ---- group: Sort the numbers to min, average and max for the further full building calculat
boxplot = Boxplot(total_lca_impact=beams_total_lca_impact_kg_co2_m2_y)

# ---- group: Create the boxplot
boolean_toggle = BooleanToggle(False)

# ----
# Foundation wall above earth
# Foundation
# Foundation wall below earth
foundation_wall_above_earth_lca_data = Data(impact_15)
foundation_wall_below_earth_lca_data = Data(impact_16)

addition_2 = Addition(A=foundation_wall_above_earth_lca_data, B=graft(foundation_wall_below_earth_lca_data))  # -> flatten(Result)
sort_3 = SortList(Keys=addition_2)  # -> Keys, ValuesA
dcon_3 = DeleteConsecutive(Set=sort_3.Keys, Wrap=False)  # -> Set, Count
foundation_total_lca_impact = Data(dcon_3.Set)

area_11 = Area(categories_area=unit_2, categories=categories, category="Foundation")
multiplication_6 = Multiplication(A=foundation_total_lca_impact, B=area_11)
division_13 = Division(A=multiplication_6, B=panel_22)
division_14 = Division(A=division_13, B=building_lifetime)
foundation_total_lca_impactt_kg_co2_m2_y = Data(division_14)

boxplot_2 = Boxplot(total_lca_impact=foundation_total_lca_impactt_kg_co2_m2_y)

# ----
# Insulation
# Interior wall
# Interior boards and panels
# Interior surface
# Structure
interior_boards_and_panels_lca_data = Data(impact_22)
interior_surface_lca_data = Data(impact_23)
insulation_lca_data = Data(impact_21)
structure_lca_data = Data(impact_24)

addition_3 = Addition(A=insulation_lca_data, B=graft(interior_boards_and_panels_lca_data))  # -> flatten(Result)
addition_4 = Addition(A=addition_3, B=graft(interior_surface_lca_data))  # -> flatten(Result)
addition_5 = Addition(A=addition_4, B=graft(structure_lca_data))  # -> flatten(Result)
sort_4 = SortList(Keys=addition_5)  # -> Keys, ValuesA
dcon_4 = DeleteConsecutive(Set=sort_4.Keys, Wrap=False)  # -> Set, Count
interior_wall_total_lca_impact = Data(dcon_4.Set)

area_12 = Area(categories_area=unit_2, categories=categories, category="Interior wall")
multiplication_7 = Multiplication(A=interior_wall_total_lca_impact, B=area_12)
division_15 = Division(A=multiplication_7, B=panel_22)
division_16 = Division(A=division_15, B=building_lifetime)
interior_wall_total_lca_impactt_kg_co2_m = Data(division_16)  # "Interior wall Total LCA Impactt (kg CO2/m2/y)"

boxplot_3 = Boxplot(total_lca_impact=interior_wall_total_lca_impactt_kg_co2_m)

# ----
# Facade
# Exterior wall
# Insulation
# Interior board and panels
# Interior surface
# Structure
interior_board_and_panels_lca_data = Data(impact_3)
interior_surface_lca_data_2 = Data(impact_13)
insulation_lca_data_2 = Data(impact_2)
structure_lca_data_2 = Data(impact_14)
facade_lca_data = Data(impact)

addition_6 = Addition(A=graft(facade_lca_data), B=insulation_lca_data_2)  # -> flatten(Result)
addition_7 = Addition(A=graft(addition_6), B=interior_board_and_panels_lca_data)  # -> flatten(Result)
addition_8 = Addition(A=graft(addition_7), B=interior_surface_lca_data_2)  # -> flatten(Result)
addition_9 = Addition(A=graft(addition_8), B=structure_lca_data_2)  # -> flatten(Result)
sort_5 = SortList(Keys=addition_9)  # -> Keys, ValuesA
dcon_5 = DeleteConsecutive(Set=sort_5.Keys, Wrap=False)  # -> Set, Count
exterior_wall_total_lca_impact = Data(dcon_5.Set)

area_13 = Area(categories_area=unit_2, categories=categories, category="Exterior wall")
multiplication_8 = Multiplication(A=exterior_wall_total_lca_impact, B=area_13)
division_17 = Division(A=multiplication_8, B=panel_22)
division_18 = Division(A=division_17, B=building_lifetime)
exterior_wall_total_lca_impactt_kg_co2_m = Data(division_18)  # "Exterior wall Total LCA Impactt (kg CO2/m2/y)"

boxplot_4 = Boxplot(total_lca_impact=exterior_wall_total_lca_impactt_kg_co2_m)

# ----
# Flooring
# Terrain
# Insulation
# Slab
insulation_lca_data_3 = Data(impact_11)
flooring_lca_data = Data(impact_10)
slab_lca_data = Data(impact_12)

addition_10 = Addition(A=flooring_lca_data, B=graft(insulation_lca_data_3))  # -> flatten(Result)
addition_11 = Addition(A=addition_10, B=graft(slab_lca_data))  # -> flatten(Result)
sort_6 = SortList(Keys=addition_11)  # -> Keys, ValuesA
dcon_6 = DeleteConsecutive(Set=sort_6.Keys, Wrap=False)  # -> Set, Count
terrain_total_lca_impact = Data(dcon_6.Set)

area_14 = Area(categories_area=unit_2, categories=categories, category="Terrain")
multiplication_9 = Multiplication(A=terrain_total_lca_impact, B=area_14)
division_19 = Division(A=multiplication_9, B=panel_22)
division_20 = Division(A=division_19, B=building_lifetime)
terrain_total_lca_impactt_kg_co2_m2_y = Data(division_20)

boxplot_5 = Boxplot(total_lca_impact=terrain_total_lca_impactt_kg_co2_m2_y)

# ----
# Ceiling
# Roofing
# Insulation
# Structure
insulation_lca_data_4 = Data(impact_8)
structure_lca_data_3 = Data(impact_9)
ceiling_lca_data = Data(impact_7)

addition_12 = Addition(A=ceiling_lca_data, B=graft(insulation_lca_data_4))  # -> flatten(Result)
addition_13 = Addition(A=addition_12, B=graft(structure_lca_data_3))  # -> flatten(Result)
sort_7 = SortList(Keys=addition_13)  # -> Keys, ValuesA
dcon_7 = DeleteConsecutive(Set=sort_7.Keys, Wrap=False)  # -> Set, Count
roofing_total_lca_impact = Data(dcon_7.Set)

area_15 = Area(categories_area=unit_2, categories=categories, category="Roofing")
multiplication_10 = Multiplication(A=roofing_total_lca_impact, B=area_15)
division_21 = Division(A=multiplication_10, B=panel_22)
division_22 = Division(A=division_21, B=building_lifetime)
roofing_total_lca_impactt_kg_co2_m2_y = Data(division_22)

boxplot_6 = Boxplot(total_lca_impact=roofing_total_lca_impactt_kg_co2_m2_y)

# ----
# Windows
windows_lca_data = Data(impact_17)

sort_8 = SortList(Keys=windows_lca_data)  # -> Keys, ValuesA
dcon_8 = DeleteConsecutive(Set=sort_8.Keys, Wrap=False)  # -> Set, Count
windows_total_lca_impact = Data(dcon_8.Set)

area_16 = Area(categories_area=unit_2, categories=categories, category="Windows")
multiplication_11 = Multiplication(A=windows_total_lca_impact, B=area_16)
division_23 = Division(A=multiplication_11, B=panel_22)
division_24 = Division(A=division_23, B=building_lifetime)
windows_total_lca_impactt_kg_co2_m2_y = Data(division_24)

boxplot_7 = Boxplot(total_lca_impact=windows_total_lca_impactt_kg_co2_m2_y)

# ----
# Columns
# Columns
columns_lca_data = Data(impact_18)

sort_9 = SortList(Keys=columns_lca_data)  # -> Keys, ValuesA
dcon_9 = DeleteConsecutive(Set=sort_9.Keys, Wrap=False)  # -> Set, Count
columns_total_lca_impact = Data(dcon_9.Set)

area_17 = Area(categories_area=unit_2, categories=categories, category="Columns")
multiplication_12 = Multiplication(A=columns_total_lca_impact, B=area_17)
division_25 = Division(A=multiplication_12, B=panel_22)
division_26 = Division(A=division_25, B=building_lifetime)
columns_total_lca_impactt_kg_co2_m2_y = Data(division_26)

boxplot_8 = Boxplot(total_lca_impact=columns_total_lca_impactt_kg_co2_m2_y)

# ----
# Ceiling
# Floor slabs
# Flooring
# Slab
flooring_lca_data_2 = Data(impact_5)
ceiling_lca_data_2 = Data(impact_4)
slab_lca_data_2 = Data(impact_6)

addition_14 = Addition(A=ceiling_lca_data_2, B=graft(flooring_lca_data_2))  # -> flatten(Result)
addition_15 = Addition(A=addition_14, B=graft(slab_lca_data_2))  # -> flatten(Result)
sort_10 = SortList(Keys=addition_15)  # -> Keys, ValuesA
dcon_10 = DeleteConsecutive(Set=sort_10.Keys, Wrap=False)  # -> Set, Count
floor_slabs_total_lca_impact = Data(dcon_10.Set)

area_18 = Area(categories_area=unit_2, categories=categories, category="Floor slabs")
multiplication_13 = Multiplication(A=floor_slabs_total_lca_impact, B=area_18)
division_27 = Division(A=multiplication_13, B=panel_22)
division_28 = Division(A=division_27, B=building_lifetime)
floor_slabs_total_lca_impactt_kg_co2_m2 = Data(division_28)  # "Floor slabs Total LCA Impactt (kg CO2/m2/y)"

boxplot_9 = Boxplot(total_lca_impact=floor_slabs_total_lca_impactt_kg_co2_m2)

# ----
# Doors
# Exterior door
doors_lca_data = Data(impact_19)

sort_11 = SortList(Keys=doors_lca_data)  # -> Keys, ValuesA
dcon_11 = DeleteConsecutive(Set=sort_11.Keys, Wrap=False)  # -> Set, Count
exterior_door_total_lca_impact = Data(dcon_11.Set)

area_19 = Area(categories_area=unit_2, categories=categories, category="Exterior door")
multiplication_14 = Multiplication(A=exterior_door_total_lca_impact, B=area_19)
division_29 = Division(A=multiplication_14, B=panel_22)
division_30 = Division(A=division_29, B=building_lifetime)
exterior_door_total_lca_impactt_kg_co2_m = Data(division_30)  # "Exterior door Total LCA Impactt (kg CO2/m2/y)"

boxplot_10 = Boxplot(total_lca_impact=exterior_door_total_lca_impactt_kg_co2_m)

# ----
# Doors
# Interior door
doors_lca_data_2 = Data(impact_20)

sort_12 = SortList(Keys=doors_lca_data_2)  # -> Keys, ValuesA
dcon_12 = DeleteConsecutive(Set=sort_12.Keys, Wrap=False)  # -> Set, Count
interior_door_total_lca_impact = Data(dcon_12.Set)

area_20 = Area(categories_area=unit_2, categories=categories, category="Interior door")
multiplication_15 = Multiplication(A=interior_door_total_lca_impact, B=area_20)
division_31 = Division(A=multiplication_15, B=panel_22)
division_32 = Division(A=division_31, B=building_lifetime)
interior_door_total_lca_impactt_kg_co2_m = Data(division_32)  # "Interior door Total LCA Impactt (kg CO2/m2/y)"

boxplot_11 = Boxplot(total_lca_impact=interior_door_total_lca_impactt_kg_co2_m)

# ---- group: Add all components to find the total building LCA impact from materials
components_total_lca_impact = ComponentsTotalLCAImpact(
    beams_lca_impact=boxplot,
    columns_lca_impact=boxplot_8,
    exterior_door_lca_impact=boxplot_10,
    exterior_wall_lca_impact=boxplot_4,
    floor_slabs_lca_impact=boxplot_9,
    foundation_lca_impact=boxplot_2,
    interior_door_lca_impact=boxplot_11,
    interior_wall_lca_impact=boxplot_3,
    roofing_lca_impact=boxplot_6,
    terrain_lca_impact=boxplot_5,
    windows_lca_impact=boxplot_7)

# ---- group: Add reference technical installations
technical_installations = Panel("0.46")
addition_16 = Addition(A=components_total_lca_impact, B=technical_installations)

# ---- group: Add reference operational energy from BUILD (60 buildings)
operational_energy = Panel("2.6")
# Results
addition_17 = Addition(A=addition_16, B=operational_energy)

# ----
building_total_lca_impact = Data(addition_17)

# ---- group: All the data is collected in one tree with every component as a branch
building = Data(building_total_lca_impact)
beams_4 = Data(beams_total_lca_impact_kg_co2_m2_y)
columns_4 = Data(columns_total_lca_impactt_kg_co2_m2_y)
exterior_door_3 = Data(exterior_door_total_lca_impactt_kg_co2_m)
exterior_wall_4 = Data(exterior_wall_total_lca_impactt_kg_co2_m)
floor_slabs_4 = Data(floor_slabs_total_lca_impactt_kg_co2_m2)
foundation_3 = Data(foundation_total_lca_impactt_kg_co2_m2_y)
interior_door = Data(interior_door_total_lca_impactt_kg_co2_m)
interior_wall_4 = Data(interior_wall_total_lca_impactt_kg_co2_m)
roofing = Data(roofing_total_lca_impactt_kg_co2_m2_y)
terrain_3 = Data(terrain_total_lca_impactt_kg_co2_m2_y)
windows_4 = Data(windows_total_lca_impactt_kg_co2_m2_y)
entwine = Entwine(
    Branch00=building,
    Branch01=beams_4,
    Branch02=columns_4,
    Branch03=exterior_door_3,
    Branch04=exterior_wall_4,
    Branch05=floor_slabs_4,
    Branch06=foundation_3,
    Branch07=interior_door,
    Branch08=interior_wall_4,
    Branch09=roofing,
    Branch010=terrain_3,
    Branch011=windows_4,
    FlattenInputs=True)  # -> simplify(Result)

# ----
tsort_2 = SortText(Keys=category, Culture=127)  # -> Keys, Values
merge_4 = Merge(Data1="Building", Data2=tsort_2.Keys)
data_5 = Data(merge_4)

# ---- group: Select what should be plotted
item_selector = ItemSelector(
    data_5,
    {"Building", "Beams", "Columns", "Exterior door", "Exterior wall", "Floor slabs", "Foundation", "Interior door", "Interior wall", "Roofing", "Terrain", "Windows"}, selected="Building")

# ----
mindex_13 = MemberIndex(Set=data_5, Member=item_selector)  # -> Index, Count
# Visualization
branch_20 = TreeBranch(Tree=entwine, Path=mindex_13.Index, MaintainPaths=True)
box_plot = BoxPlot(
    NumericalData=branch_20,
    MainTitle="LCA results",
    XAxisTitle=item_selector,
    YAxisTitle="kg CO2-eq/m2/year",
    ColorList=ColourSwatch(SwatchColor=RGB(63, 204, 129)),
    Enable=boolean_toggle)

# ==== cluster NormalsMANI
amplitude = ClusterInput()
amplitude_2 = Data(amplitude)
geo = ClusterInput()
merge = Merge(Data1=flatten(amplitude_2), Data2=flatten("1m"))
geo_2 = Geometry(geo)
item = ListItem(List=merge, Index=0, Wrap=True)
facen = FaceNormals(Mesh=geo_2)  # -> Centers, Normals
U = Units(ValueString=item)
avr = Average(Input=facen.Centers)
avr_2 = Average(Input=facen.Normals)
unflatten = UnflattenTree(Tree=avr, Guide=geo_2)
unflatten_2 = UnflattenTree(Tree=avr_2, Guide=geo_2)
amp = Amplitude(Vector=unflatten_2, Amplitude=U)
pl = PlaneNormal(Origin=unflatten, ZAxis=unflatten_2)
norm = Vector(amp)
center = Point(unflatten)
P = ClusterOutput(pl)
norm_2 = ClusterOutput(norm)
center_2 = ClusterOutput(center)

# ==== cluster Cluster
A = ClusterInput()
division = Division(A=A, B="100")
data = ClusterInput()
subtraction = Subtraction(A="1", B=division)
data_2 = Data(data)
multiplication = Multiplication(A=data_2, B=subtraction)
multiplication_2 = Multiplication(A=data_2, B=division)
R = ClusterOutput(multiplication)
R_2 = ClusterOutput(multiplication_2)

# ==== cluster Component
lca_data = ClusterInput()
categories = ClusterInput()
data = ClusterInput()
categories_match = ClusterInput()
sorting = ClusterInput()
category_unit = ClusterInput()
headers = ClusterInput()
lca_data_2 = Data(lca_data)
categories_2 = Data(categories)
data_2 = Data(data)
categories_match_2 = Data(categories_match)
sorting_2 = Data(sorting)
category_unit_2 = Data(category_unit)
headers_2 = Data(headers)
headers_3 = ClusterOutput(headers_2)

# ---- group: Choose category
mindex = MemberIndex(Set=categories_2, Member=data_2)  # -> Index, Count
branch = TreeBranch(Tree=sorting_2, Path=mindex.Index, MaintainPaths=True)  # -> flatten(Branch)
item = ListItem(List=lca_data_2, Index=branch, Wrap=True)

# ---- group: Find unit
mindex_2 = MemberIndex(Set=categories_match_2, Member=data_2)  # -> Index, Count
item_2 = ListItem(List=category_unit_2, Index=mindex_2.Index, Wrap=True)

# ---- group: Remove values with another unit
data_3 = Data(item)
mindex_3 = MemberIndex(Set=headers_2, Member="Unit")  # -> Index, Count
branch_2 = TreeBranch(Tree=data_3, Path=mindex_3.Index, MaintainPaths=True)
mindex_4 = MemberIndex(Set=branch_2, Member=item_2)  # -> Index, Count
item_3 = ListItem(List=data_3, Index=mindex_4.Index, Wrap=True)  # -> simplify(Item)
category_lca_data = Data(item_3)

# ---- group: Divide in subcategories
mindex_5 = MemberIndex(Set=headers_2, Member="Product")  # -> Index, Count
branch_3 = TreeBranch(Tree=category_lca_data, Path=mindex_5.Index, MaintainPaths=True)
tsort = SortText(Keys=branch_3, Culture=127)  # -> Keys, Values
dcon = DeleteConsecutive(Set=tsort.Keys, Wrap=False)  # -> Set, Count
mindex_6 = MemberIndex(Set=branch_3, Member=dcon.Set)  # -> simplify(Index), Count
subcategory_index = Data(mindex_6.Index)
subcategories = Data(dcon.Set)

# ----
category_lca_data_2 = ClusterOutput(category_lca_data)
lng = ListLength(List=subcategories)
subcategory_index_2 = ClusterOutput(subcategory_index)
subcategories_2 = ClusterOutput(subcategories)
subtraction = Subtraction(A=lng, B="1")
dom = ConstructDomain(DomainStart=0, DomainEnd=subtraction)
range = Range(Domain=dom, Steps=subtraction)
cluster = Cluster_2(data=range)
subcategory_range = Data(cluster)
subcategory_range_2 = ClusterOutput(subcategory_range)

# ==== cluster Product
category_lca_data = ClusterInput()
subcategory_index = ClusterInput()
subcategories = ClusterInput()
subcategory_number = ClusterInput()
category_lca_data_2 = Data(category_lca_data)
subcategory_index_2 = Data(subcategory_index)
subcategories_2 = Data(subcategories)
subcategory_number_2 = Data(subcategory_number)
item = ListItem(List=subcategories_2, Index=subcategory_number_2, Wrap=True)
branch = TreeBranch(Tree=subcategory_index_2, Path=subcategory_number_2, MaintainPaths=True)
null = NullItem(Item=branch)  # -> NullFlags, InvalidFlags, Description
ma = MassAddition(Input=null.NullFlags)  # -> Result, PartialResults
cull = CullPattern(List=subcategory_index_2, CullPattern=ma.Result)  # -> flatten(List)
cull_2 = CullPattern(List=branch, CullPattern=invert(ma.Result))
merge = Merge(Data1=cull, Data2=cull_2)
item_2 = ListItem(List=category_lca_data_2, Index=flatten(merge), Wrap=True)
headers = ClusterInput()
subcategory_lca_data = Data(item_2)
subcategory = Data(item)
headers_2 = Data(headers)
headers_3 = ClusterOutput(headers_2)
subcategory_2 = ClusterOutput(subcategory)
subcategory_lca_data_2 = ClusterOutput(subcategory_lca_data)

# ==== cluster Material
subcategory_lca_data = ClusterInput()
headers = ClusterInput()
subcategory_lca_data_2 = Data(subcategory_lca_data)
headers_2 = Data(headers)
mindex = MemberIndex(Set=headers_2, Member="Material")  # -> Index, Count
subcategory_lca_data_3 = ClusterOutput(subcategory_lca_data_2)
branch = TreeBranch(Tree=subcategory_lca_data_2, Path=mindex.Index, MaintainPaths=True)
tsort = SortText(Keys=branch, Culture=127)  # -> Keys, Values
dcon = DeleteConsecutive(Set=tsort.Keys, Wrap=False)  # -> Set, Count
material_list = Data(branch)
materials = Data(dcon.Set)
material_list_2 = ClusterOutput(material_list)
materials_2 = ClusterOutput(materials)

# ==== cluster Select
material_list = ClusterInput()
material = ClusterInput()
subcategory_lca_data = ClusterInput()
material_list_2 = Data(material_list)
material_2 = Data(material)
subcategory_lca_data_2 = Data(subcategory_lca_data)
mindex = MemberIndex(Set=material_list_2, Member=material_2)  # -> flatten(Index), Count
lng = ListLength(List=subcategory_lca_data_2)  # -> flatten(Length)
item = ListItem(List=lng, Index=0, Wrap=True)
null = NullItem(Item=mindex.Index)  # -> NullFlags, InvalidFlags, Description
subtraction = Subtraction(A=item, B="1")
dom = ConstructDomain(DomainStart=0, DomainEnd=subtraction)
range = Range(Domain=dom, Steps=subtraction)
cluster = Cluster_2(data=range)
ma = MassAddition(Input=null.NullFlags)  # -> Result, PartialResults
cull = CullPattern(List=mindex.Index, CullPattern=invert(ma.Result))
cull_2 = CullPattern(List=cluster, CullPattern=ma.Result)
merge = Merge(Data1=cull, Data2=cull_2)  # -> flatten(Result)
item_2 = ListItem(List=subcategory_lca_data_2, Index=merge, Wrap=True)
material_3 = Data(item_2)
material_4 = ClusterOutput(material_3)

# ==== cluster Material_2
material_lca_data = ClusterInput()
headers = ClusterInput()
headers_2 = Data(headers)
material_lca_data_2 = Data(material_lca_data)
mindex = MemberIndex(Set=headers_2, Member="Name")  # -> Index, Count
material_lca_data_3 = ClusterOutput(material_lca_data_2)
branch = TreeBranch(Tree=material_lca_data_2, Path=mindex.Index, MaintainPaths=True)
tsort = SortText(Keys=branch, Culture=127)  # -> Keys, Values
dcon = DeleteConsecutive(Set=tsort.Keys, Wrap=False)  # -> Set, Count
product_list = Data(branch)
products = Data(dcon.Set)
product_list_2 = ClusterOutput(product_list)
products_2 = ClusterOutput(products)

# ==== cluster Impact
lca_data = ClusterInput()
headers = ClusterInput()
lca_data_2 = Data(lca_data)
headers_2 = Data(headers)
flip = FlipMatrix(Data=lca_data_2)
panel = Panel("""A1-A3
A4
A5
B4
B6
C3-C4""")
mindex = MemberIndex(Set=headers_2, Member=panel)  # -> flatten(Index), Count
item = ListItem(List=flip, Index=mindex.Index, Wrap=True)
ma = MassAddition(Input=item)  # -> flatten(Result), PartialResults
lca_impact = Data(ma.Result)
lca_impact_2 = ClusterOutput(lca_impact)

# ==== cluster Area
categories_area = ClusterInput()
category = ClusterInput()
categories = ClusterInput()
categories_area_2 = Data(categories_area)
category_2 = Data(category)
categories_2 = Data(categories)
mindex = MemberIndex(Set=categories_2, Member=category_2)  # -> Index, Count
item = ListItem(List=categories_area_2, Index=mindex.Index, Wrap=True)
category_area = Data(item)
category_area_2 = ClusterOutput(category_area)

# ==== cluster Boxplot
total_lca_impact = ClusterInput()
total_lca_impact_2 = Data(total_lca_impact)
sort = SortList(Keys=total_lca_impact_2)  # -> Keys, ValuesA
item = ListItem(List=reverse(sort.Keys), Index=0, Wrap=True)
avr = Average(Input=sort.Keys)
item_2 = ListItem(List=sort.Keys, Index=0, Wrap=True)
merge = Merge(Data1=item_2, Data2=avr, Data3=item)
lca_impact_for_calculation = Data(merge)
lca_impact_for_calculation_2 = ClusterOutput(lca_impact_for_calculation)

# ==== cluster ComponentsTotalLCAImpact
beams_lca_impact = ClusterInput()
columns_lca_impact = ClusterInput()
exterior_door_lca_impact = ClusterInput()
exterior_wall_lca_impact = ClusterInput()
floor_slabs_lca_impact = ClusterInput()
foundation_lca_impact = ClusterInput()
interior_door_lca_impact = ClusterInput()
interior_wall_lca_impact = ClusterInput()
roofing_lca_impact = ClusterInput()
terrain_lca_impact = ClusterInput()
windows_lca_impact = ClusterInput()
beams_lca_impact_2 = Data(beams_lca_impact)
columns_lca_impact_2 = Data(columns_lca_impact)
exterior_door_lca_impact_2 = Data(exterior_door_lca_impact)
exterior_wall_lca_impact_2 = Data(exterior_wall_lca_impact)
floor_slabs_lca_impact_2 = Data(floor_slabs_lca_impact)
foundation_lca_impact_2 = Data(foundation_lca_impact)
interior_door_lca_impact_2 = Data(interior_door_lca_impact)
interior_wall_lca_impact_2 = Data(interior_wall_lca_impact)
roofing_lca_impact_2 = Data(roofing_lca_impact)
terrain_lca_impact_2 = Data(terrain_lca_impact)
windows_lca_impact_2 = Data(windows_lca_impact)
addition = Addition(A=beams_lca_impact_2, B=graft(columns_lca_impact_2))  # -> flatten(Result)
addition_2 = Addition(A=addition, B=graft(exterior_door_lca_impact_2))  # -> flatten(Result)
addition_3 = Addition(A=addition_2, B=graft(exterior_wall_lca_impact_2))  # -> flatten(Result)
addition_4 = Addition(A=addition_3, B=graft(floor_slabs_lca_impact_2))  # -> flatten(Result)
addition_5 = Addition(A=addition_4, B=graft(foundation_lca_impact_2))  # -> flatten(Result)
addition_6 = Addition(A=addition_5, B=graft(interior_door_lca_impact_2))  # -> flatten(Result)
addition_7 = Addition(A=addition_6, B=graft(interior_wall_lca_impact_2))  # -> flatten(Result)
addition_8 = Addition(A=addition_7, B=graft(roofing_lca_impact_2))  # -> flatten(Result)
addition_9 = Addition(A=addition_8, B=graft(terrain_lca_impact_2))  # -> flatten(Result)
addition_10 = Addition(A=addition_9, B=graft(windows_lca_impact_2))  # -> flatten(Result)
sort = SortList(Keys=addition_10)  # -> Keys, ValuesA
dcon = DeleteConsecutive(Set=sort.Keys, Wrap=False)  # -> Set, Count
components_total_lca_impact = Data(dcon.Set)
components_total_lca_impact_2 = ClusterOutput(components_total_lca_impact)

# ==== cluster Cluster_2
data = ClusterInput()
data_2 = Data(data)
null = NullItem(Item=data_2)  # -> NullFlags, InvalidFlags, Description
cull = CullPattern(List=data_2, CullPattern=invert(null.NullFlags))
cull_2 = CullPattern(List="0", CullPattern=null.NullFlags)
merge = Merge(Data1=cull_2, Data2=cull)  # -> flatten(Result)
data_3 = Data(merge)
data_4 = ClusterOutput(data_3)
